% Simulink data dictionary global_data.sldd

ControllerConfiguration = Simulink.ConfigSet(StartTime="0", StopTime="inf", FixedStep="Ts", Solver="FixedStepDiscrete", ProdHWDeviceType="ARM Compatible->ARM Cortex-M", SystemTargetFile="ert.tlc", TargetLang="C")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
Ts = Simulink.Parameter(0.1)